# Dynamo graph RevisionsOnSheet.dyn (Dynamo 0.8.1.1942)

# group: Get the desired Sheet Set:
get_all_sheet_sets = Python()
# ---------- get_all_sheet_sets.python (50 lines) ----------
import clr
clr.AddReference('ProtoGeometry')
from Autodesk.DesignScript.Geometry import *

# Import DocumentManager
clr.AddReference("RevitServices")
import RevitServices
from RevitServices.Persistence import DocumentManager

# Import ToDSType(bool) extension method
clr.AddReference("RevitNodes")
import Revit
clr.ImportExtensions(Revit.Elements)

# Import RevitAPI
clr.AddReference("RevitAPI")
import Autodesk
from Autodesk.Revit.DB import *

# Import DocumentManager and TransactionManager
from RevitServices.Persistence import DocumentManager
from RevitServices.Transactions import TransactionManager
from System.Collections.Generic import*

doc = DocumentManager.Instance.CurrentDBDocument
uiapp = DocumentManager.Instance.CurrentUIApplication
app = uiapp.Application

# The inputs to this node will be stored as a list in the IN variables.
dataEnteringNode = IN

# Sheet sets collection
#sheetSetsCollection = []
sheetSetsCollectionNames = []
#sheetsInCollection = []

# Collect all the sheet sets from the document
collection = FilteredElementCollector(doc)
collection.OfClass(ViewSheetSet)

for item in collection:
	#sheetSetsCollection.append(item)
	sheetSetsCollectionNames.append(item.Name.ToString())
	#tempSheets = []
	#for sheets in item.Views:
		#tempSheets.append(sheets)
	#sheetsInCollection.append(tempSheets)

# Assign your output to the OUT variable.
OUT = sheetSetsCollectionNames
# ----------------------------------------
code_block = CodeBlock { 1; }
getItemAtIndex = List.GetItemAtIndex(list=get_all_sheet_sets, index=code_block)

get_all_sheets_in_the_sheet_set = Python(IN[0]=getItemAtIndex)
# ---------- get_all_sheets_in_the_sheet_set.python (47 lines) ----------
import clr
clr.AddReference('ProtoGeometry')
from Autodesk.DesignScript.Geometry import *

# Import DocumentManager
clr.AddReference("RevitServices")
import RevitServices
from RevitServices.Persistence import DocumentManager

# Import ToDSType(bool) extension method
clr.AddReference("RevitNodes")
import Revit
clr.ImportExtensions(Revit.Elements)

# Import RevitAPI
clr.AddReference("RevitAPI")
import Autodesk
from Autodesk.Revit.DB import *

# Import DocumentManager and TransactionManager
from RevitServices.Persistence import DocumentManager
from RevitServices.Transactions import TransactionManager
from System.Collections.Generic import*

doc = DocumentManager.Instance.CurrentDBDocument
uiapp = DocumentManager.Instance.CurrentUIApplication
app = uiapp.Application

# The inputs to this node will be stored as a list in the IN variables.
dataEnteringNode = IN

sheetSetNameToProcess = IN[0]
# Sheet sets collection
sheetSetsCollectionNames = []
sheetsInCollection = []

# Collect all the sheet sets from the document
collection = FilteredElementCollector(doc)
collection.OfClass(ViewSheetSet)

for item in collection:
	if item.Name.ToString() == sheetSetNameToProcess :
		for sheets in item.Views:
			sheetsInCollection.append(sheets)

# Assign your output to the OUT variable.
OUT = sheetsInCollection
# ----------------------------------------

# group: Miscellaneous Items for Sheets:
parameters = CodeBlock { "Appears In Sheet List"; "Sheet Number"; }
getParameterValueByName = Element.GetParameterValueByName(element=get_all_sheets_in_the_sheet_set, parameterName=parameters.out0)
getParameterValueByName_2 = Element.GetParameterValueByName(element=get_all_sheets_in_the_sheet_set, parameterName=parameters.out1)
code_block_2 = CodeBlock { 1; }
setParameterByName = Element.SetParameterByName(parameterName=parameters.out0, value=code_block_2)

# group: Feed Sheets into "element" to set sheet parameters:
code_block_3 = CodeBlock { "Sheet Issue Date"; "2015/08/14"; }
setParameterByName_2 = Element.SetParameterByName(parameterName=code_block_3.out0, value=code_block_3.out1)

# group: Pick the Revision Id that you wish to check: (not the Sequence Number)
get_all_project_revisions = Python()
# ---------- get_all_project_revisions.python (44 lines) ----------
import clr
clr.AddReference('ProtoGeometry')
from Autodesk.DesignScript.Geometry import *

# Import DocumentManager
clr.AddReference("RevitServices")
import RevitServices
from RevitServices.Persistence import DocumentManager

# Import ToDSType(bool) extension method
clr.AddReference("RevitNodes")
import Revit
clr.ImportExtensions(Revit.Elements)

# Import RevitAPI
clr.AddReference("RevitAPI")
import Autodesk
from Autodesk.Revit.DB import *

# Import DocumentManager and TransactionManager
from RevitServices.Persistence import DocumentManager
from RevitServices.Transactions import TransactionManager
from System.Collections.Generic import*

doc = DocumentManager.Instance.CurrentDBDocument
uiapp = DocumentManager.Instance.CurrentUIApplication
app = uiapp.Application

# The inputs to this node will be stored as a list in the IN variables.
dataEnteringNode = IN

# Revisions in the project
allRevisionsInProject = []

# Collect all the Revisions from the document
collection = FilteredElementCollector(doc)
collection.OfCategory(BuiltInCategory.OST_Revisions)

for item in collection:
	#RevParameters = item.get_Parameters()
	allRevisionsInProject.append(item)

# Assign your output to the OUT variable.
OUT = allRevisionsInProject #,RevParameters
# ----------------------------------------
parameters_2 = Element.Parameters(get_all_project_revisions)
code_block_4 = CodeBlock { 0; }
getItemAtIndex_2 = List.GetItemAtIndex(list=get_all_project_revisions, index=code_block_4)

# group: Check various parameters in the sheets collection:
parameters_3 = Element.Parameters(get_all_sheets_in_the_sheet_set)

existing_revisions_in_sheet = Python(IN[0]=get_all_sheets_in_the_sheet_set)
# ---------- existing_revisions_in_sheet.python (47 lines) ----------
import clr
clr.AddReference('ProtoGeometry')
from Autodesk.DesignScript.Geometry import *

# Import DocumentManager
clr.AddReference("RevitServices")
import RevitServices
from RevitServices.Persistence import DocumentManager

# Import ToDSType(bool) extension method
clr.AddReference("RevitNodes")
import Revit
clr.ImportExtensions(Revit.Elements)

# Import RevitAPI
clr.AddReference("RevitAPI")
import Autodesk
from Autodesk.Revit.DB import ReferencePointArray

#clr.AddReference("LibGNet")
#from Autodesk.LibG import*

# Import DocumentManager and TransactionManager
from RevitServices.Persistence import DocumentManager
from RevitServices.Transactions import TransactionManager
from System.Collections.Generic import *

doc = DocumentManager.Instance.CurrentDBDocument
uiapp = DocumentManager.Instance.CurrentUIApplication
app = uiapp.Application

#The inputs to this node will be stored as a list in the IN variables.
dataEnteringNode = IN

#Incoming nodes
listOfSheets = UnwrapElement( IN[0] )  #The sheets to process
#Get all the Revisions in the Sheets
revisionsInSheets = []
for item in listOfSheets:
	tempList = item.GetAdditionalProjectRevisionIds()
	tempRevisions = []
	for i, e in enumerate(tempList):
		tempRevisions.append(doc.GetElement(e))
	revisionsInSheets.append(tempRevisions)

#Assign your output to the OUT variable.
OUT = revisionsInSheets
# ----------------------------------------

# group: Toggle True to make Changes in the Revit: You may have to update interaction with Revit by breaking and reconnecting one of the wires in the begining.
boolean = BoolSelector(false)
update_revisions_in_sheet = Python(IN[0]=get_all_sheets_in_the_sheet_set, IN[1]=existing_revisions_in_sheet, IN[2]=getItemAtIndex_2, IN[3]=boolean)
# ---------- update_revisions_in_sheet.python (74 lines) ----------
import clr
clr.AddReference('ProtoGeometry')
from Autodesk.DesignScript.Geometry import *

# Import DocumentManager
clr.AddReference("RevitServices")
import RevitServices
from RevitServices.Persistence import DocumentManager

# Import ToDSType(bool) extension method
clr.AddReference("RevitNodes")
import Revit
clr.ImportExtensions(Revit.Elements)

# Import RevitAPI
clr.AddReference("RevitAPI")
import Autodesk
from Autodesk.Revit.DB import ReferencePointArray

#clr.AddReference("LibGNet")
#from Autodesk.LibG import*

# Import DocumentManager and TransactionManager
from RevitServices.Persistence import DocumentManager
from RevitServices.Transactions import TransactionManager
from System.Collections.Generic import *

doc = DocumentManager.Instance.CurrentDBDocument
uiapp = DocumentManager.Instance.CurrentUIApplication
app = uiapp.Application

#The inputs to this node will be stored as a list in the IN variables.
dataEnteringNode = IN

#Incoming nodes
listOfSheets = UnwrapElement( IN[0] )  #The sheets to process
existingRevisions = UnwrapElement( IN[1] ) #The exising list of revisions in sheets
revisionElementToCheck = UnwrapElement( IN[2] ) #The revision element to check
canNodeRun = IN[3] 	#Boolean to control execution of the function


revisionsInSheets = []	#List for revisions update
#Check if the exising list of revisions contains the desired revision element to check
#If not add it to the list
for i in range(len(existingRevisions)):
	tempList = []
	for j in range(len(existingRevisions[i])):
		tempList.append(existingRevisions[i][j].Id)
	tempList.append(revisionElementToCheck.Id)
	revisionsInSheets.append(tempList)

#Remove the duplicates from the list. See if work without removing duplicates
			
# "SetAdditionalProjectRevisionIds requires a iCollection object which is a List object in Python
convertedList = []

for i, item in enumerate(revisionsInSheets):
	listObjectCast = List[Autodesk.Revit.DB.ElementId](revisionsInSheets[i])
	convertedList.append(listObjectCast)	

# Boolean to check if code should make the Revit changes
if canNodeRun:
	# Start Transaction
	TransactionManager.Instance.EnsureInTransaction(doc)

	# Change the given Revision element 
	for i, item in enumerate(listOfSheets):
		item.SetAdditionalProjectRevisionIds(convertedList[i])

	# End Transaction
	TransactionManager.Instance.TransactionTaskDone()

#Assign your output to the OUT variable.
OUT =  convertedList
# ----------------------------------------
